% Simulink data dictionary VehicleData.sldd

g = 9.81
A_F = 2.341157
C_d = 0.24
rho = 1.225
f = 0.01
V_wind = 0
transGear = 0.1027
lf = 1.1
lr = 1.58
Iz = 2873
m = 2238.932
h_aero = 0.65
h_gc = 0.65
Nf = 2
Nr = 2
theta = 0
r_w = 0.352
r_stat = 0.342
C_af = 80000
C_ar = 80000
Cfg_LateralDynaEn = Simulink.Parameter(false, DataType="boolean")
InitialX = -180.9111
InitialY = 80.96413
InitialPsi = 0.7853982