% Simulink data dictionary VehicleData.sldd

g = 9.81
A_F = 2.341157
C_d = 0.24
rho = 1.225
f = 0.01
V_wind = 0
transGear = 0.1027
C_af = 80000
C_ar = 80000
lf = 1.1
lr = 1.58
Iz = 2873
m = 2238.932
h_aero = 0.65
h_gc = 0.65
Nf = 2
Nr = 2
theta = 0
r_w = 0.352
r_stat = 0.342
InitialX = -181.3419
InitialY = 78.53502
InitialPsi = 4.709388